# Grasshopper definition rpi-template.ghx (Grasshopper 0.9.76)
# plug-ins: Python Interpreter, KUKA|prc - parametric robot control

# Generic Digital (0)
# Put in advanced/code/krl settings in PRC Core: &ACCESS RVP
# &REL 1
# &PARAM TEMPLATE = C:\KRC\Roboter\Template\vorgabe
# &PARAM EDITMASK = *
# [PROJECTNAME]
# ;FOLD Declaration
# [SPLITDEFS]
# INT i
# INT OFFSET
# CHAR Bytes[16]
# INT COMMAND
# INT DATA0
# INT DATA1
# INT DATA2
# DECL EKI_STATUS RET
# ;ENDFOLD
# ;FOLD INI
# ;FOLD BASISTECH INI
# GLOBAL INTERRUPT DECL 3 WHEN $STOPMESS==TRUE DO IR_STOPM ( )
# INTERRUPT ON 3
# BAS (#INITMOV,0 )
# ;ENDFOLD (BASISTECH INI)
# ;ENDFOLD (INI)
# FOR  i=(1) TO (16)
# Bytes[i]=0
# ENDFOR
# OFFSET=0
# DATA0=0
# DATA1=1
# DATA2=2
# 
# 
# [STARTAXPOS]
# 
# [SETPARAMETERS]
# 
# 
# 
# 
# RET=EKI_Init("RPiDigital")
# RET=EKI_Open("RPiDigital")
# [COMMANDS]
# 
# RET=EKI_Close("RPiDigital")
# RET=EKI_Clear("RPiDigital")
# 
# END
id = Slider(0, range=0..6)
# Generic Serial (1)
# Put in advanced/code/krl settings in PRC Core: &ACCESS RVP
# &REL 1
# &PARAM TEMPLATE = C:\KRC\Roboter\Template\vorgabe
# &PARAM EDITMASK = *
# [PROJECTNAME]
# ;FOLD Declaration
# [SPLITDEFS]
# INT i
# INT OFFSET
# CHAR Bytes[16]
# INT COMMAND
# INT DATA0
# INT DATA1
# INT DATA2
# DECL EKI_STATUS RET
# ;ENDFOLD
# ;FOLD INI
# ;FOLD BASISTECH INI
# GLOBAL INTERRUPT DECL 3 WHEN $STOPMESS==TRUE DO IR_STOPM ( )
# INTERRUPT ON 3
# BAS (#INITMOV,0 )
# ;ENDFOLD (BASISTECH INI)
# ;ENDFOLD (INI)
# FOR  i=(1) TO (16)
# Bytes[i]=0
# ENDFOR
# OFFSET=0
# DATA0=0
# DATA1=1
# DATA2=2
# 
# 
# [STARTAXPOS]
# 
# [SETPARAMETERS]
# 
# 
# 
# 
# RET=EKI_Init("RPiUART")
# RET=EKI_Open("RPiUART")
# [COMMANDS]
# 
# RET=EKI_Close("RPiUART")
# RET=EKI_Clear("RPiUART")
# 
# END
number_slider = Slider(0, range=0..255)
panel = Panel("""1
0
0
1
0
0
1""")

digital_values = Integer(panel)
python_all_output = PythonScript(values=digital_values)  # -> binary, name; inputs values: list of Int32
# ---------- python_all_output: Python ----------
binary = 0
binary += 1  * values[0]
binary += 2  * values[1]
binary += 4  * values[2]
binary += 8  * values[3]
binary += 16 * values[4]
binary += 32 * values[5]
binary += 64 * values[6]
binary += 128
print(binary)
binary = chr(binary)

name = ""
for i in range(7):
    name += str(values[i])
# ---------- end python_all_output ----------
send_bytes_krl = Panel(""";FOLD Digital Out - Set All {1}
WAIT SEC .1
RET=EKI_Init("RPiDigital")
RET=EKI_Open("RPiDigital")
OFFSET=0
COMMAND={0}
CAST_TO(Bytes[],OFFSET,COMMAND)
RET = EKI_Send("VacuumGripper",Bytes[])
RET=EKI_Close("RPiDigital")
RET=EKI_Clear("RPiDigital")
;ENDFOLD""")
panel_2 = Panel(python_all_output.binary)
format = Format(Format=send_bytes_krl, Culture=127, Data0=python_all_output.binary, Data1=python_all_output.name)
custom_krl = KUKAPrcCustomKRL(TextAsKRL=format)

int = Integer(id)
bool = Boolean(Toggle(True))
python_single_output = PythonScript(id=int, value=bool)  # -> binary, name; inputs id: Int32
# ---------- python_single_output: Python ----------
binary = 0
binary += 64 * value
binary += 1 * (id & 1 == 1)
binary += 2 * (id & 2 == 2)
binary += 4 * (id & 4 == 4)
print(binary)
binary = chr(binary)

name = "Pin " + str(id) + " : " + ("HIGH" if value else "LoW")
# ---------- end python_single_output ----------
send_bytes_krl_2 = Panel(""";FOLD Digital Out - Set Single {1}
WAIT SEC .1
RET=EKI_Init("RPiDigital")
RET=EKI_Open("RPiDigital")
OFFSET=0
COMMAND={0}
CAST_TO(Bytes[],OFFSET,COMMAND)
RET = EKI_Send("VacuumGripper",Bytes[])
RET=EKI_Close("RPiDigital")
RET=EKI_Clear("RPiDigital")
;ENDFOLD""")
panel_3 = Panel(python_single_output.binary)
format_2 = Format(Format=send_bytes_krl_2, Culture=127, Data0=python_single_output.binary, Data1=python_single_output.name)
custom_krl_2 = KUKAPrcCustomKRL(TextAsKRL=format_2)

command = Integer(number_slider)
data0 = Integer(Slider(0, range=0..255))
data1 = Integer(Slider(0, range=0..255))
data2 = Integer(Slider(0, range=0..255))
python_uart = PythonScript(command=command, data0=data0, data1=data1, data2=data2)  # -> binary, name; inputs command: Int32
# ---------- python_uart: Python ----------
binary = 0
binary += command % 256
binary *= 256
binary += data0 % 256
binary *= 256
binary += data1 % 256
binary *= 256
binary += data2 % 256

name = str(command) + " " + str(data0) + " " + str(data1) + " " + str(data2)
# ---------- end python_uart ----------
send_bytes_krl_3 = Panel(""";FOLD Serial Out {1}
WAIT SEC .1
RET=EKI_Init("RPiUART")
RET=EKI_Open("RPiUART")
OFFSET=0
COMMAND={0}
CAST_TO(Bytes[],OFFSET, COMMAND, DATA0, DATA1, DATA2)
RET = EKI_Send("VacuumGripper",Bytes[])
RET=EKI_Close("RPiUART")
RET=EKI_Clear("RPiUART")
;ENDFOLD""")
panel_4 = Panel(python_uart.binary)
format_3 = Format(Format=send_bytes_krl_3, Culture=127, Data0=python_uart.binary, Data1=python_uart.name)
custom_krl_3 = KUKAPrcCustomKRL(TextAsKRL=format_3)
