# Grasshopper definition template-grasshopper.gh (Grasshopper 0.9.76)
# plug-ins: KUKA|prc - parametric robot control, Telepathy

# ---- group: Input
# Grasshopper Template: Use this definition as a starting point for workflows involving Arduino based tools
# 
# This definition uses the Telepathy plugin to connect the Input group to different places. Tool commands and the core template work fine without it however.
# Input: This block includes controls for setting the filename of the exported .src file, and a Save button
# 
# It also inlcludes a more fine-grain control for the PRC simulation slider input, allowing the user to set the range within the total program they are scrubbing through.
panel = Panel("my_filename")
dom = ConstructDomain(DomainStart=Slider(0, range=0..1), DomainEnd=Slider(1, range=0..1))
save_src_file = Button()
remap = RemapNumbers(Value=Slider(0.529, range=0..1), Source=Domain(0, 1), Target=dom)  # -> Mapped, Clipped
simulation_position = RemoteSender(remap.Mapped)

# ----
bool_save_button = RemoteSender(save_src_file)
txt_filename = RemoteSender(panel)
command_names = Panel("TURN_ON_OFF")
txt_command_names = Text(command_names)

# ---- group: Tool Command
# Tool Command: Produces KRL commands for controlling tools; either the group or the cluster can be used interchangably
# Input a series of command ids and command data.
# The user should also input a list of the names of the tool commands; these are included in the .src file for better readability
command = Integer()
data = Integer()
send_bytes_krl = Panel("""; {2} {1}
TOOL_COMMAND1({0},{1})""")
item = ListItem(List=txt_command_names, Index=command, Wrap=True)
format = Format(Format=send_bytes_krl, Culture=127, Data0=command, Data1=data, Data2=item)
custom_krl = KUKAPrcCustomKRL(TextAsKRL=format)  # -> simplify(KUKAPrcCommand)
kuka_command = KUKAPrcCommand(custom_krl)

# ----
command_2 = Integer()
data_2 = Integer()
txt_command_names_2 = Text(command_names)
tool_command = ToolCommand(command=command_2, data=data_2)
kuka_command_2 = KUKAPrcCommand(tool_command)
custom_tool = CustomToolKUKAPrc(toolid=16, toolvala=0, toolvalb=0, toolvalc=0, toolvalx=0, toolvaly=0, toolvalz=0, valuesset=True)

# ---- group: KUKA Core
# Kuka Core: The KUKA|prc core component here contains a necessary code template for opening and closing the network connection.
# 
# If your definition doesn't start from this file, you will at least need to copy the core component to your file, or the code from the 'Advanced/Code/KRL Settings' tab of the core to your core.
simulation_position_2 = RemoteReceiver(simulation_position)
kuka_command_3 = KUKAPrcCommand()
kr_6_10_r900 = KUKAAgilusKR6KR10R900(infiniterot=False)
bool_save_button_2 = RemoteReceiver(bool_save_button)
txt_filename_2 = RemoteReceiver(txt_filename)
kuka_prc = KUKAPrcCORE(
    SimulationSlider=simulation_position_2,
    KUKAPrcCommands=kuka_command_3,
    KUKAPrcTool=custom_tool,
    KUKAPrcRobot=kr_6_10_r900,
    SaveToggle=bool_save_button_2,
    Filename=txt_filename_2,
    PRC_BaseExpose=False,
    PRC_SaveNameExpose=True,
    PRCsettings="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")  # -> RobotGeometry, AnalysisOutput

# ---- group: KUKA Analysis
analysis = KUKAPrcAnalysis(KUKAPrcAnalysisData=kuka_prc.AnalysisOutput)  # -> RobotAxisValues, RobotCollisionCheck, RobotReachabilityCheck, CommandID, TimeValue, Planes, CommandTags, IOState, Index, KRL
panel_2 = Panel("{0}")  # disabled
branch = TreeBranch(Tree=kuka_prc.RobotGeometry, Path=panel_2, MaintainPaths=True)  # disabled
ma = MassAddition(Input=flatten(analysis.RobotCollisionCheck))  # -> Result, PartialResults
ma_2 = MassAddition(Input=flatten(analysis.RobotReachabilityCheck))  # -> Result, PartialResults
mesh_robot_preview_mesh = Mesh(branch)  # disabled
int_collision_error_count = Integer(ma.Result)
int_reachability_error_count = Integer(ma_2.Result)
panel_3 = Panel(int_collision_error_count)
panel_4 = Panel(int_reachability_error_count)

# ==== cluster ToolCommand
command = ClusterInput()
data = ClusterInput()
command_names = ClusterInput()
send_bytes_krl = Panel("""; {2} {1}
TOOL_COMMAND1({0},{1})""")
item = ListItem(List=command_names, Index=command, Wrap=True)
format = Format(Format=send_bytes_krl, Culture=127, Data0=command, Data1=data, Data2=item)
custom_krl = KUKAPrcCustomKRL(TextAsKRL=format)  # -> simplify(KUKAPrcCommand)
krl_command = ClusterOutput(custom_krl)
